# Dynamo graph DataToExcel.dyn (Dynamo 2.19.3.6394)

categories = Categories("OST_MechanicalEquipment")
current = Document.Current()
activeView = Document.ActiveView(document=current)
all_elements_of_category_in_view = ElementsOfCategoryInView(Category=categories, View=activeView)
solids = Element.Solids(element=all_elements_of_category_in_view)  # frozen
categories_2 = Categories("OST_Rooms")
all_elements_of_category = ElementsOfCategory(Category=categories_2)
solids_2 = Element.Solids(element=all_elements_of_category)  # frozen
directory_path = Directory("C:\Users\ychiang2\Desktop\20250513\ExyteHelloWorld\ExyteDynamo")
code_block = CodeBlock(D=directory_path) { D + "/equ_room_data.xlsx"; }
code_block_2 = CodeBlock { "data1"; }
code_block_3 = CodeBlock { 0; }
elementType = Element.ElementType(element=all_elements_of_category_in_view)
string = StringInput("Level")
getParameterValueByName = Element.GetParameterValueByName(element=all_elements_of_category, parameterName=string)
getLocation = Element.GetLocation(element=all_elements_of_category_in_view)
isInsideRoom = Room.IsInsideRoom(room=all_elements_of_category, point=getLocation@L1)
boolean = BoolSelector(true)
indexOf = List.IndexOf(list=isInsideRoom@L2, element=boolean)
getItemAtIndex = List.GetItemAtIndex(list=getParameterValueByName, index=indexOf)
string_2 = StringInput("Department")
getParameterValueByName_2 = Element.GetParameterValueByName(element=all_elements_of_category, parameterName=string_2)
getItemAtIndex_2 = List.GetItemAtIndex(list=getParameterValueByName_2, index=indexOf)
name = Room.Name(room=all_elements_of_category)
getItemAtIndex_3 = List.GetItemAtIndex(list=name, index=indexOf)
number = Room.Number(room=all_elements_of_category)
getItemAtIndex_4 = List.GetItemAtIndex(list=number, index=indexOf)
list_create = List.Create(item0=elementType, item1=getItemAtIndex, item2=getItemAtIndex_2, item3=getItemAtIndex_3, item4=getItemAtIndex_4)
transpose = List.Transpose(lists=list_create)
exportToExcel = Data.ExportToExcel(filePath=code_block, sheetName=code_block_2, startRow=code_block_3, startColumn=code_block_3, data=transpose)
